vi "Main.gviweb"   [LabVIEW NXG 2.0.0]
panel controls:
  "Trigger Send": bool
  "Trigger Reset": bool
panel indicators:
  "Send File": bool
  "Reset": bool
  "Disk Usage": f64
  "Memory Usage": f64
  "Files Sent": i32
  "Buffer": i32
  "Chart": T1
types:
  T1 = cluster{"Element 1": f64, "Element 2": f64, "Element 3": f64, "Element 4": f64}
uses:
  NI::Skyline::TagHTTP::Create Configuration.gvi
  NI::Skyline::MessageHTTP::Open.gvi
  NI::Skyline::MessageHTTP::Publish.gvi
  NI::Skyline::MessageHTTP::Close.gvi
  NI::Skyline::TagHTTP::Open Tag.gvi
  NI::Skyline::TagHTTP::Reset Aggregates (Single).gvi
  NI::Skyline::TagHTTP::Close Tag (Single).gvi
  NI::Skyline::TagHTTP::Read Tag (DBL).gvi
  NI::Skyline::TagHTTP::Read Tag (I32).gvi
diagram:
  w1 = "ni-crio-9068-190cb7b"  # Target
  w2 = "/"  # Server
  call "Create Configuration.gvi"(server url=w2, username="", password="") -> (configuration=w3)
  while {
    Wait(time to wait=50)
    case ($"Trigger Send") {
      frame False, Default {
        $"Send File" <- FALSE
      }
      frame True {
        Wait(time to wait=500)
        $"Send File" <- TRUE
        call "Open.gvi"(configuration=w3) -> (message session out=w4)
        call "Publish.gvi"(message session=w4, topic="send_file", message="send_file") -> (message session out=w5, error out=w6)
        call "Close.gvi"(message session=w5, error in=w6)
      }
    }
    case ($"Trigger Reset") {
      frame False, Default {
        $Reset <- FALSE
      }
      frame True {
        $Reset <- TRUE
        Concatenate Strings(w1, ".ai.", "0") -> w7
        call "Open Tag.gvi"(path=w7, data type="Double", configuration=w3) -> (tag out=w8, error out=w9)
        call "Reset Aggregates (Single).gvi"(tag in=w8, error in=w9) -> (tag out=w10, error out=w11)
        call "Close Tag (Single).gvi"(tag=w10, error in=w11)
        Wait(time to wait=500)
      }
    }
    stop if FALSE
  }
  while {
    Wait(time to wait=1000)
    w12 = ["disk.usage", "memory.usage", "files_sent", "buffer", "ai.0"]
    for (iteration -> i1) {
      w13 = each element of w12
      Concatenate Strings(w1, ".", w13) -> w14
      case (i1) {
        frame 0, Default {
          call "Open Tag.gvi"(path=w14, data type="Double", configuration=w3) -> (tag out=w15, error out=w16)
          call "Read Tag (DBL).gvi"(tag in=w15, error in=w16) -> (tag out=w17, error out=w18, value=w19)
          call "Close Tag (Single).gvi"(tag=w17, error in=w18)
          $"Disk Usage" <- w19
        }
        frame 1 {
          call "Open Tag.gvi"(path=w14, data type="Double", configuration=w3) -> (tag out=w20, error out=w21)
          call "Read Tag (DBL).gvi"(tag in=w20, error in=w21) -> (tag out=w22, error out=w23, value=w24)
          call "Close Tag (Single).gvi"(tag=w22, error in=w23)
          $"Memory Usage" <- w24
        }
        frame 2 {
          call "Open Tag.gvi"(path=w14, data type="Integer", configuration=w3) -> (tag out=w25, error out=w26)
          call "Read Tag (I32).gvi"(tag in=w25, error in=w26) -> (tag out=w27, error out=w28, value=w29)
          call "Close Tag (Single).gvi"(tag=w27, error in=w28)
          $"Files Sent" <- w29
        }
        frame 3 {
          call "Open Tag.gvi"(path=w14, data type="Integer", configuration=w3) -> (tag out=w30, error out=w31)
          call "Read Tag (I32).gvi"(tag in=w30, error in=w31) -> (tag out=w32, error out=w33, value=w34)
          call "Close Tag (Single).gvi"(tag=w32, error in=w33)
          $Buffer <- w34
        }
        frame 4 {
          call "Open Tag.gvi"(path=w14, data type="Double", configuration=w3) -> (tag out=w35, error out=w36)
          call "Read Tag (DBL).gvi"(tag in=w35, error in=w36) -> (tag out=w37, error out=w38, value=w39, aggregates=w40)
          Property Node(instance in=w40) -> ("Min"=w41, "Mean"=w42, "Max"=w43)
          Build Cluster(w39, w41, w42, w43) -> w44
          $Chart <- w44
          call "Close Tag (Single).gvi"(tag=w37, error in=w38)
        }
      }
    }
    stop if FALSE
  }
