vi "Function.gviweb"   [LabVIEW Platform Developer Preview 0.1.0]
panel controls:
  "Trigger Send": bool
  "Trigger Reset": bool
panel indicators:
  "Send File": bool
  "Temp": T1
  "Buffer": f64
  "Files Sent": f64
  "Available Memory": f64
  "Available Disk": f64
  "Reset": bool
types:
  T1 = cluster{"Element 1": f64, "Element 2": f64, "Element 3": f64, "Element 4": f64}
uses:
  Component::Reset Aggregates.gviweb
  Component::Send Message.gviweb
  Component::Read Tag (Double).gviweb
diagram:
  w1 = "ni-crio-9068-190cb7b"  # Target
  w2 = "54.82.138.142"  # Server
  while {
    Wait(time to wait=50)
    case ($"Trigger Reset") {
      frame False, Default {
        $Reset <- FALSE
      }
      frame True {
        Wait(time to wait=500)
        $Reset <- TRUE
        Concatenate Strings(w1, ".", "ai.0") -> w3
        call "Reset Aggregates.gviweb"(Server=w2, Tag=w3)
      }
    }
    case ($"Trigger Send") {
      frame False, Default {
        $"Send File" <- FALSE
      }
      frame True {
        $"Send File" <- TRUE
        call "Send Message.gviweb"(Server=w2, Topic="send_file", Message="send_file")
        Wait(time to wait=500)
      }
    }
    stop if FALSE
  }
  while {
    Wait(time to wait=1000)
    w4 = ["available_disk", "available_memory", "files_sent", "buffer", "ai.0"]
    for (iteration -> i1) {
      w5 = each element of w4
      Concatenate Strings(w1, ".", w5) -> w6
      case (i1) {
        frame 0, Default {
          call "Read Tag (Double).gviweb"(Server=w2, Tag=w6) -> (Value=w7)
          $"Available Disk" <- w7
        }
        frame 1 {
          call "Read Tag (Double).gviweb"(Server=w2, Tag=w6) -> (Value=w8)
          $"Available Memory" <- w8
        }
        frame 2 {
          call "Read Tag (Double).gviweb"(Server=w2, Tag=w6) -> (Value=w9)
          $"Files Sent" <- w9
        }
        frame 3 {
          call "Read Tag (Double).gviweb"(Server=w2, Tag=w6) -> (Value=w10)
          $Buffer <- w10
        }
        frame 4 {
          call "Read Tag (Double).gviweb"(Server=w2, Tag=w6) -> (Value=w11, Average=w12, Minimum=w13, Maximum=w14)
          Build Cluster(w11, w12, w13, w14) -> w15
          $Temp <- w15
        }
      }
    }
    stop if FALSE
  }
