vi "Reset Aggregates.gviweb"   [LabVIEW Platform Developer Preview 0.1.0]
inputs:
  "Server": string
  "Tag": string
uses:
  NI::HTTP::POST Buffer.gvi
diagram:
  Concatenate Strings("http://", $Server, "/nitag/tag/", $Tag, "/reset_aggregates") -> w1
  call "POST Buffer.gvi"(url=w1)
